# Dynamo graph DeleteSheetnView-script.dyn (Dynamo 2.16.2.5624)
# packages: archi-lab.net 2022.212.2722, Data-Shapes 2022.2.103, Genius Loci 2021.11.10, WWP Packages 0.0.1

collector_of_views = Custom[Collector of Views]()  # package Genius Loci; Collects all views in the active or given document.
string = StringInput("Print Set")
getParameterValueByName = Element.GetParameterValueByName(element=collector_of_views.Sheet, parameterName=string)
string_2 = StringInput("Select Print Set to Delete")
wwp_logo = Custom[WWP - Logo]()  # package WWP Packages; Black and White Logo
code_block = CodeBlock { true; "Confirm, Delete Selected"; "Cancel"; }
uniqueItems = List.UniqueItems(list=getParameterValueByName)
flatten = List.Flatten(list=uniqueItems)
python_script = Python(IN[0]=flatten)  # IronPython2
# ---------- python_script.python (14 lines) ----------
# Load the Python Standard and DesignScript Libraries
import sys
import clr
clr.AddReference('ProtoGeometry')
from Autodesk.DesignScript.Geometry import *

name= IN[0]
list = []

for i in name:
	if i == "":
		i = "???"
	list.append(i)
OUT = list
# ----------------------------------------
listview_data = Custom[Listview Data](Keys=python_script, Values=flatten)  # package Data-Shapes; Create data for ListView input in UI.MultiInputForm ++ . Check out www.data-shapes.net for more infos.
multipleinputform = Custom[MultipleInputForm ++](Description_optional=string_2, Logo_optional=wwp_logo, ButtonText_optional=code_block.out1, Inputs=listview_data, Toggle=code_block.out0, CancelButtonText_optional=code_block.out2)  # package Data-Shapes; Create a form with multiple inputs. see www.data-shapes.net for tutorials and infos!
firstItem = List.FirstItem(list=multipleinputform.User_Inputs)
python_script_2 = Python(IN[0]=getParameterValueByName, IN[1]=firstItem)  # IronPython2
# ---------- python_script_2.python (18 lines) ----------
# Load the Python Standard and DesignScript Libraries
import sys
import clr
clr.AddReference('ProtoGeometry')
from Autodesk.DesignScript.Geometry import *

list1=IN[0]
list2=IN[1]
list3=[]

for i in list1:
    if i in list2:
        result=True
    else:
        result=False
    list3.append(result)

OUT = list3
# ----------------------------------------
flatten_2 = List.Flatten(list=python_script_2)
filterByBoolMask = List.FilterByBoolMask(list=collector_of_views.Sheet, mask=flatten_2)
delete = archilab.Revit.Elements.Elements.Delete(element=filterByBoolMask.in)
code_block_2 = CodeBlock { true; }
contains = List.Contains(list=delete, item=code_block_2)
